# Grasshopper definition HopesTest.gh (Grasshopper 1.0.7)

gallery = ImageGallery(CycleDelay=30, Randomize=False, UseLocalImages=True, UseRemoteImages=True)
num1 = GetInteger(Slider(1, range=0..1), AtLeast=1, AtMost=1, Maximum=2147483647, Minimum=-2147483648, TreeAccess=False)
num2 = GetInteger(Slider(1, range=0..1), AtLeast=1, AtMost=1, Maximum=2147483647, Minimum=-2147483648, TreeAccess=False)
num3 = GetInteger(Slider(1, range=0..1), AtLeast=1, AtMost=1, Maximum=2147483647, Minimum=-2147483648, TreeAccess=False)

# ----
# Color Format
# Input
data = Data(1)
# Method
data_2 = Data(1)
# Output
data_3 = Data(1)
# Display
data_4 = Data(1)
# Unuse
data_5 = Data(1)

addition = Addition(A=num1, B=num2, C=num3)
filepath = ContextPrint(Integer=addition)
